# Dynamo custom node Select Element by Parameter.dyf (Dynamo 1.2.1.3083)
# category: Revit.Elements.Parameter

ElementsIN = Input()
ParameterName = Input()
getParameterValueByName = Element.GetParameterValueByName(element=ElementsIN, parameterName=ParameterName)
ParameterValue = Input()
eq = getParameterValueByName == ParameterValue
filterByBoolMask = List.FilterByBoolMask(list=ElementsIN, mask=eq)
in_ = Output(filterByBoolMask.in)  # "in"
out = Output(filterByBoolMask.out)
