# Dynamo graph GenMEP Conduit.dyn (Dynamo 1.2.1.3083)

# group: Horizontal Start Points
x_point_input = CodeBlock { 23; }
y_input_point = CodeBlock { 17.25..19..1/4; }
z_point_input = CodeBlock { 111.25..112.25..1/4; }
byCoordinates = Point.ByCoordinates(x=x_point_input, y=y_input_point, z=z_point_input, lacing=CrossProduct)
code_block = CodeBlock { 2; }
flatten = List.Flatten(list=byCoordinates, amt=code_block)
X = Point.X(byCoordinates)
code_block_2 = CodeBlock { 1.5; }
add = X + code_block_2
Y = Point.Y(byCoordinates)
Z = Point.Z(byCoordinates)
byCoordinates_2 = Point.ByCoordinates(x=add, y=Y, z=Z)
flatten_2 = List.Flatten(list=byCoordinates_2, amt=code_block)

# group: Horizontal Target Points
x_point_input_2 = CodeBlock { {-46,-38,-30,-18,-10,-1,11,19}; }
code_block_3 = CodeBlock { 17.25..19..1/4; }
z_point_input_2 = CodeBlock { 109.25; }
byCoordinates_3 = Point.ByCoordinates(x=x_point_input_2, y=code_block_3, z=z_point_input_2)
X_2 = Point.X(byCoordinates_3)
Y_2 = Point.Y(byCoordinates_3)
Z_2 = Point.Z(byCoordinates_3)
code_block_4 = CodeBlock { 1; }
add_2 = Z_2 + code_block_4
byCoordinates_4 = Point.ByCoordinates(x=X_2, y=Y_2, z=add_2)

start_points = List.Join(flatten, byCoordinates_3)
target_points = List.Join(flatten_2, byCoordinates_4)

# group: Draw conduit stubs
levels = Levels("GROUND FLOOR")
categories = Categories("Conduit")
all_elements_of_category = ElementsOfCategory(categories)
code_block_5 = CodeBlock { 0; }
getItemAtIndex = List.GetItemAtIndex(list=all_elements_of_category, index=code_block_5)
code_block_6 = CodeBlock { "Type Id"; }
getParameterValueByName = Element.GetParameterValueByName(element=getItemAtIndex, parameterName=code_block_6)
draw_conduit = Python(IN[0]=start_points, IN[1]=target_points, IN[2]=levels, IN[3]=getParameterValueByName)
# ---------- draw_conduit.python (83 lines) ----------
import clr
# Import DocumentManager and TransactionManager
clr.AddReference('RevitServices')
import RevitServices
from RevitServices.Persistence import DocumentManager
from RevitServices.Transactions import TransactionManager
# Import RevitAPI
clr.AddReference('RevitAPI')
import Autodesk
# Import Revit Nodes 
clr.AddReference("RevitNodes")
import Revit
clr.ImportExtensions(Revit.Elements)
clr.ImportExtensions(Revit.GeometryConversion)
# Import from Revit DB and all its parts
from Autodesk.Revit.DB import *
# Import from Revit Creation where the Create.NewDuct class is.
from Autodesk.Revit.Creation import *
# Import ToProtoType, ToRevitType geometry conversion extension methods


#Defining Current document
doc = DocumentManager.Instance.CurrentDBDocument

#Konrad K Sobon's code from http://goo.gl/D4v6LU
#Split single string at line breaks into a list of strings
#xyzList = IN[0].rsplit("\n")
# Cull the first line, which is header
#del xyzList[0]
# Cull the last line, which is blank
#del xyzList[len(xyzList)-1]


#Create empty list for points x and y
#x = []
#y = []

#Define Ducttype but not need to be provided by user,
# it will the first it finds
#conduittype = Autodesk.Revit.DB.ElementId.InvalidElementId()
#conduittype = Autodesk.Revit.DB.
conduittype =  UnwrapElement(IN[3])

#conduittype = Autodesk.Revit.DB.Electrical.Conduit.IsValidConduitType(doc,IN[1])
#OUT = conduittype
start = IN[0]
target = IN[1]
level = UnwrapElement(IN[2])
#OUT = IN[1]

#Iterate over list using Konrad K Sobon list to points script
#for xyz in xyzList:
#    tpt = xyz.rsplit(',')
    #OUT = tpt
    #convert first coord to points and to mm, as revit api 
    #works with decimal feets you need to divide the float into 304.8 to mantain mm
    #x.append(Autodesk.Revit.DB.XYZ((float(tpt[0])/304.8),(float(tpt[1])/304.8),(float(tpt[2])/304.8)).ToPoint())
    #convert second coord to points and in to mm
    #y.append(Autodesk.Revit.DB.XYZ((float(tpt[3])/304.8),(float(tpt[4])/304.8),(float(tpt[5])/304.8)).ToPoint())
    
    #Print x &amp;amp;amp;amp;amp;amp; y points created    
#OUT = x,y

elements = []

# Start Transaction
TransactionManager.Instance.EnsureInTransaction(doc)
#Create a duct from each couple of x &amp;amp;amp;amp;amp;amp; y points
#for i,h in zip(x,y):
#Convert points to Xyz
    #x=i.ToXyz()
    #y=h.ToXyz()
    #doc.Create.NewDuct(start, target, Ducttype);
    
#doc.Create.Pipe(start, target, Ducttype);
for i,x in enumerate(start):
	conduit = Autodesk.Revit.DB.Electrical.Conduit.Create(doc,conduittype.Id,start[i].ToXyz(),target[i].ToXyz(),level.Id)

	elements.append(conduit.Id)
# Stop Transaction
TransactionManager.Instance.TransactionTaskDone()

OUT = elements
# ----------------------------------------

# note: Last 8 IDs are Target stubs
watch = Watch(draw_conduit)
y_count = Count(flatten)
takeItems = List.TakeItems(list=watch, amount=y_count)
z_count = Count(z_point_input)
code_block_7 = CodeBlock(total=z_count) { 1..total..1; }
group_start_sets_of_stubs = List.TakeEveryNthItem(takeItems, z_count, code_block_7)
code_block_8 = CodeBlock { 1; }
flatten_3 = List.Flatten(list=group_start_sets_of_stubs, amt=code_block_8)
target_stub_ids = List.DropItems(list=watch, amount=y_count)
cycle = List.Cycle(list=target_stub_ids, amount=z_count)

# group: Calculate All Routes GenMEP AutoRouting API BuildingSP.com
autoRoutingAPI = BuildingSP_API.AutoRoutingAPI.AutoRoutingAPI()
uiapp_python_script = Python()  # unwired: IN[0]
# ---------- uiapp_python_script.python (21 lines) ----------
import clr
# Import DocumentManager
clr.AddReference("RevitServices")
import RevitServices
from RevitServices.Persistence import DocumentManager
from RevitServices.Transactions import TransactionManager

doc = DocumentManager.Instance.CurrentDBDocument
uiapp = DocumentManager.Instance.CurrentUIApplication
app = uiapp.Application

#Assign your output to the OUT variable


# Start Transaction
#TransactionManager.Instance.EnsureInTransaction(doc)

# Stop Transaction
#TransactionManager.Instance.TransactionTaskDone()

OUT = uiapp
# ----------------------------------------
end = Revit.Transaction.Transaction.End(flatten_3)
end_2 = Revit.Transaction.Transaction.End(cycle)
clearance = CodeBlock { 0; }
solveToFailure = BoolSelector(true)
route_name = CodeBlock { "Route_xx"; }
direct = BuildingSP_API.RouteSelection.Direct()
lateAlignment = BuildingSP_API.Algorithm.LateAlignment()
minimize_elbows_pipe = BoolSelector(false)
offset_bend_angle = CodeBlock { 45; }
routing_timeout = CodeBlock { 20; }
byAllParameters = BuildingSP_API.RoutingParameters.ByAllParameters(clearance, solveToFailure, route_name, direct, lateAlignment, minimize_elbows_pipe, offset_bend_angle, routing_timeout)
calculateRoute = BuildingSP_API.AutoRoutingAPI.CalculateRoute(autoRoutingAPI, uiapp_python_script, end, end_2, byAllParameters)

# group: Score Best Route
numberOfElbows = BuildingSP_API.RoutingResults.NumberOfElbows(calculateRoute)
watch_2 = Watch(numberOfElbows)
cost_per_bend = CodeBlock { 13.04; }
mul = watch_2 * cost_per_bend
roughLength = BuildingSP_API.RoutingResults.RoughLength(calculateRoute)
watch_3 = Watch(roughLength)
cost_per_ft = CodeBlock { 4.12; }
mul_2 = watch_3 * cost_per_ft
add_3 = mul + mul_2
code_block_9 = CodeBlock { 8; }
chop = List.Chop(list=add_3, lengths=code_block_9)
sum = Math.Sum(chop)
minimumItem = List.MinimumItem(sum)
best_route = List.FirstIndexOf(list=sum, item=minimumItem)
getItemAtIndex_2 = List.GetItemAtIndex(list=group_start_sets_of_stubs, index=best_route)

# group: Model Best Solution GenMEP AutoRouting API BuildingSP.com
autoRoutingAPI_2 = BuildingSP_API.AutoRoutingAPI.AutoRoutingAPI()
uiapp_python_script_2 = Python()  # unwired: IN[0]; same code as uiapp_python_script
end_3 = Revit.Transaction.Transaction.End(getItemAtIndex_2)
end_4 = Revit.Transaction.Transaction.End(target_stub_ids)
clearance_2 = CodeBlock { 0; }
solveToFailure_2 = BoolSelector(true)
route_name_2 = CodeBlock { "Route_xx"; }
direct_2 = BuildingSP_API.RouteSelection.Direct()
lateAlignment_2 = BuildingSP_API.Algorithm.LateAlignment()
minimize_elbows_pipe_2 = BoolSelector(false)
offset_bend_angle_2 = CodeBlock { 45; }
routing_timeout_2 = CodeBlock { 20; }
byAllParameters_2 = BuildingSP_API.RoutingParameters.ByAllParameters(clearance_2, solveToFailure_2, route_name_2, direct_2, lateAlignment_2, minimize_elbows_pipe_2, offset_bend_angle_2, routing_timeout_2)
autoRoute = BuildingSP_API.AutoRoutingAPI.AutoRoute(autoRoutingAPI_2, uiapp_python_script_2, end_3, end_4, byAllParameters_2)

removeItemAtIndex = List.RemoveItemAtIndex(list=group_start_sets_of_stubs, indices=best_route)

# group: Delete Unused Stubs
code_block_10 = CodeBlock { 0; }
getItemAtIndex_3 = List.GetItemAtIndex(list=autoRoute, index=code_block_10)
join = List.Join(getItemAtIndex_3, removeItemAtIndex)
count = Count(getItemAtIndex_3)
dropItems = List.DropItems(list=join, amount=count)
id_to_element = Custom[Id to Element](Id=dropItems)  # Selects elements in a model from id input (ElementId, string, integer or GUID)
delete = Elements.Element.Delete(id_to_element)

# group: Create Junction Boxes
family_types = FamilyTypes("Junction Boxes - No Load:4\" Square")
levels_2 = Levels("GROUND FLOOR")
byPointAndLevel = FamilyInstance.ByPointAndLevel(familyType=family_types, point=byCoordinates_3, level=levels_2)
code_block_11 = CodeBlock { 90; }
setRotation = FamilyInstance.SetRotation(familyInstance=byPointAndLevel, degree=code_block_11)
