# Dynamo graph Medical EQ Power.dyn (Dynamo 1.2.1.3083)

# group: Read in list of Medical Equipment from Revit link
element_types = ElementTypes("RevitLinkInstance")
all_elements_of_type = ElementsOfType(element_types)
# note: EQ Link
code_block = CodeBlock { 5; }
getItemAtIndex = List.GetItemAtIndex(list=all_elements_of_type, index=code_block)
categories = Categories("SpecialityEquipment")
linkedInstanceElements = Custom[Springs.Collector.LinkedInstanceElements](LinkInstance=getItemAtIndex, category=categories)  # Extract elements by category from the selected linked instances. The transform vector can be used to get the exact location of the elements in the local file

# group: Filter Equipment list for previously powered Equipment
categories_2 = Categories("ElectricalFixtures")
all_elements_of_category = ElementsOfCategory(categories_2)
code_block_2 = CodeBlock { "S&L_Subscript 1"; }
getParameterValueByName = Element.GetParameterValueByName(element=all_elements_of_category, parameterName=code_block_2)
id = Element.Id(linkedInstanceElements.elements)
string_from_object = FromObject(id)
containsItem = List.ContainsItem(list=getParameterValueByName, item=string_from_object)

filterByBoolMask = List.FilterByBoolMask(list=linkedInstanceElements.elements, mask=containsItem)
watch = Watch(filterByBoolMask.out)

# group: Read in CSV list of Equipment Types
file_path = Filename(".\MED%20EQ_MBP.csv")
fromPath = FileObject(file_path)  # "File.FromPath"
readFromFile = CSV.ReadFromFile(fromPath)
flatten = Flatten(readFromFile)
code_block_3 = CodeBlock { 5; }
takeItems = List.TakeItems(list=flatten, amount=code_block_3)

# group: Create list of instances of equipment that need power
type = FamilyInstance.Type(watch)
code_block_4 = CodeBlock { "CAD ID"; }
getParameterValueByName_2 = Element.GetParameterValueByName(element=type, parameterName=code_block_4)
sort = List.Sort(getParameterValueByName_2)
uniqueItems = List.UniqueItems(sort)
count = Count(takeItems)
ofRepeatedItem = List.OfRepeatedItem(item=watch, amount=count)
eq = takeItems == getParameterValueByName_2  # lacing=CrossProduct
filterByBoolMask_2 = List.FilterByBoolMask(list=ofRepeatedItem, mask=eq)
watch_2 = Watch(filterByBoolMask_2.in)

# group: Create electrical receptacles at equipment location
family_types = FamilyTypes("Receptacle-Duplex:4 Sq Box")
location = FamilyInstance.Location(watch_2)
element_types_2 = ElementTypes("Level")
all_elements_of_type_2 = ElementsOfType(element_types_2)
code_block_5 = CodeBlock { "Host"; }
getParameterValueByName_3 = Element.GetParameterValueByName(element=watch_2, parameterName=code_block_5)
code_block_6 = CodeBlock { 14; }
code_block_7 = CodeBlock { 1; }
substring = String.Substring(str=getParameterValueByName_3, startIndex=code_block_6, length=code_block_7)
toNumber = String.ToNumber(substring)
code_block_8 = CodeBlock { 1; }
sub = toNumber - code_block_8
getItemAtIndex_2 = List.GetItemAtIndex(list=all_elements_of_type_2, index=sub)
byPointAndLevel = FamilyInstance.ByPointAndLevel(familyType=family_types, point=location, level=getItemAtIndex_2)

# group: Add parameters to new receptacles
code_block_9 = CodeBlock { "S&L_Subscript 2"; }
code_block_10 = CodeBlock { "DynamoInsertFlag"; }
setParameterByName = Element.SetParameterByName(element=byPointAndLevel, parameterName=code_block_9, value=code_block_10)
code_block_11 = CodeBlock { "S&L_Subscript 1"; }
id_2 = Element.Id(watch_2)
string_from_object_2 = FromObject(id_2)
setParameterByName_2 = Element.SetParameterByName(element=byPointAndLevel, parameterName=code_block_11, value=string_from_object_2)
code_block_12 = CodeBlock { "Offset"; }
code_block_13 = CodeBlock { 0; }
setParameterByName_3 = Element.SetParameterByName(element=byPointAndLevel, parameterName=code_block_12, value=code_block_13)
