# Dynamo graph MED EQ Link Power Placement.dyn (Dynamo 1.3.0.875)

element_types = ElementTypes("RevitLinkInstance")
all_elements_of_type = ElementsOfType(element_types)
# note: EQ Link
code_block = CodeBlock { 5; }
getItemAtIndex = List.GetItemAtIndex(list=all_elements_of_type, index=code_block)
categories = Categories("SpecialityEquipment")
boolean = BoolSelector(true)
linkedInstanceElements = Custom[Springs.Collector.LinkedInstanceElements](LinkInstance=getItemAtIndex, category=categories, refresh=boolean)  # Extract elements by category from the selected linked instances. The transform vector can be used to get the exact location of the elements in the local file
categories_2 = Categories("ElectricalFixtures")
all_elements_of_category = ElementsOfCategory(categories_2)
watch = Watch(all_elements_of_category)
code_block_2 = CodeBlock { "MedEQ ElementID_D"; }
getParameterValueByName = Element.GetParameterValueByName(element=watch, parameterName=code_block_2)
id = Element.Id(linkedInstanceElements.elements)
string_from_object = FromObject(id)
containsItem = List.ContainsItem(list=getParameterValueByName, item=string_from_object)
filterByBoolMask = List.FilterByBoolMask(list=linkedInstanceElements.elements, mask=containsItem)
code_block_3 = CodeBlock { "Host"; }
getParameterValueByName_2 = Element.GetParameterValueByName(element=filterByBoolMask.out, parameterName=code_block_3)
code_block_4 = CodeBlock { "5"; }
contains = String.Contains(str=getParameterValueByName_2, searchFor=code_block_4)
filterByBoolMask_2 = List.FilterByBoolMask(list=filterByBoolMask.out, mask=contains)
watch_2 = Watch(filterByBoolMask_2.in)
type = FamilyInstance.Type(watch_2)
code_block_5 = CodeBlock { "CAD ID"; }
getParameterValueByName_3 = Element.GetParameterValueByName(element=type, parameterName=code_block_5)
sort = List.Sort(getParameterValueByName_3)
uniqueItems = List.UniqueItems(sort)
family_types = FamilyTypes("Receptacle-Duplex:4 Sq Box")
file_path = Filename(".\MED equip 170331.xlsx")
fromPath = FileObject(file_path)  # "File.FromPath"
code_block_6 = CodeBlock { "SpecRmXRm"; }
readFromFile = Excel.ReadFromFile(file=fromPath, sheetName=code_block_6)
code_block_7 = CodeBlock { 29; }
getItemAtIndex_2 = List.GetItemAtIndex(list=readFromFile@L2, index=code_block_7)
code_block_8 = CodeBlock { "1"; }
contains_2 = String.Contains(str=getItemAtIndex_2, searchFor=code_block_8)
filterByBoolMask_3 = List.FilterByBoolMask(list=readFromFile, mask=contains_2)
code_block_9 = CodeBlock { "2"; }
contains_3 = String.Contains(str=getItemAtIndex_2, searchFor=code_block_9)
filterByBoolMask_4 = List.FilterByBoolMask(list=readFromFile, mask=contains_3)
code_block_10 = CodeBlock { "4"; }
contains_4 = String.Contains(str=getItemAtIndex_2, searchFor=code_block_10)
filterByBoolMask_5 = List.FilterByBoolMask(list=readFromFile, mask=contains_4)
join = List.Join(filterByBoolMask_3.in, filterByBoolMask_4.in, filterByBoolMask_5.in)
code_block_11 = CodeBlock { 7; }
list_getitematindex_cadid = List.GetItemAtIndex(list=join@L2, index=code_block_11)
uniqueItems_2 = List.UniqueItems(list_getitematindex_cadid)
code_block_12 = CodeBlock { 999; }
takeItems = List.TakeItems(list=uniqueItems_2, amount=code_block_12)
count = Count(takeItems)
ofRepeatedItem = List.OfRepeatedItem(item=watch_2, amount=count)
eq = takeItems == getParameterValueByName_3  # lacing=CrossProduct
filterByBoolMask_6 = List.FilterByBoolMask(list=ofRepeatedItem, mask=eq)
isEmpty = List.IsEmpty(filterByBoolMask_6.in@@L2)
filterByBoolMask_7 = List.FilterByBoolMask(list=filterByBoolMask_6.in, mask=isEmpty)
watch_3 = Watch(filterByBoolMask_7.out)
location = FamilyInstance.Location(watch_3)
element_types_2 = ElementTypes("Level")
all_elements_of_type_2 = ElementsOfType(element_types_2)
code_block_13 = CodeBlock { "Host"; }
getParameterValueByName_4 = Element.GetParameterValueByName(element=watch_3, parameterName=code_block_13)
code_block_14 = CodeBlock { 14; }
code_block_15 = CodeBlock { 1; }
substring = String.Substring(str=getParameterValueByName_4, startIndex=code_block_14, length=code_block_15)
toNumber = String.ToNumber(substring)
code_block_16 = CodeBlock { 1; }
sub = toNumber - code_block_16
getItemAtIndex_3 = List.GetItemAtIndex(list=all_elements_of_type_2, index=sub)
byPointAndLevel = FamilyInstance.ByPointAndLevel(familyType=family_types, point=location, level=getItemAtIndex_3)
code_block_17 = CodeBlock { "S&L_Subscript 2"; }
code_block_18 = CodeBlock { "benTEST4"; }
setParameterByName = Element.SetParameterByName(element=byPointAndLevel, parameterName=code_block_17, value=code_block_18)
code_block_19 = CodeBlock { "MedEQ ElementID_D"; }
id_2 = Element.Id(watch_3)
code_block_20 = CodeBlock(E_ID=id_2) { E_ID; }
string_from_object_2 = FromObject(code_block_20)
setParameterByName_2 = Element.SetParameterByName(element=byPointAndLevel, parameterName=code_block_19, value=string_from_object_2)
code_block_21 = CodeBlock { "Offset"; }
code_block_22 = CodeBlock { 0; }
setParameterByName_3 = Element.SetParameterByName(element=byPointAndLevel, parameterName=code_block_21, value=code_block_22)
code_block_23 = CodeBlock { 29; 30; 32; 35; 33; }
list_getitematindex_amps = List.GetItemAtIndex(list=join@L2, index=code_block_23.out1)
eq_2 = uniqueItems_2 == list_getitematindex_cadid  # lacing=CrossProduct
filterByBoolMask_8 = List.FilterByBoolMask(list=join, mask=eq_2@@L2)
code_block_24 = CodeBlock(watch=filterByBoolMask_8.in) { watch; }
list_getitematindex_volts = List.GetItemAtIndex(list=code_block_24@@L2, index=code_block_23.out0)
uniqueItems_3 = List.UniqueItems(list_getitematindex_volts@@L2)
flatten = Flatten(uniqueItems_3)
toNumber_2 = String.ToNumber(flatten)
code_block_25 = CodeBlock { 180; }
code_block_26 = CodeBlock { null; }
eq_3 = code_block_26 == _  # unwired: arg1
replaceByCondition = Replace(toNumber_2, code_block_25, eq_3)
code_block_27 = CodeBlock { "MedEQ CAD ID_D"; }
type_2 = FamilyInstance.Type(watch_3)
code_block_28 = CodeBlock { "CAD ID"; }
getParameterValueByName_5 = Element.GetParameterValueByName(element=type_2, parameterName=code_block_28)
setParameterByName_4 = Element.SetParameterByName(element=byPointAndLevel, parameterName=code_block_27, value=getParameterValueByName_5)
code_block_29 = CodeBlock { "Date_D"; "170412"; }
setParameterByName_5 = Element.SetParameterByName(element=byPointAndLevel, parameterName=code_block_29.out0, value=code_block_29.out1)
code_block_30 = CodeBlock { "S&L_Apparent Load"; 180; }
list_getitematindex_watts = List.GetItemAtIndex(list=code_block_24@@L2, index=code_block_23.out2)
uniqueItems_4 = List.UniqueItems(list_getitematindex_watts@@L2)
flatten_2 = Flatten(uniqueItems_4)
code_block_31 = CodeBlock { "N/A"; "180"; }
replace = String.Replace(str=flatten_2, searchFor=code_block_31.out0, replaceWith=code_block_31.out1)
code_block_32 = CodeBlock { "*"; "180"; }
replace_2 = String.Replace(str=replace, searchFor=code_block_32.out0, replaceWith=code_block_32.out1)
code_block_33 = CodeBlock { "<120"; "180"; }
replace_3 = String.Replace(str=replace_2, searchFor=code_block_33.out0, replaceWith=code_block_33.out1)
toNumber_3 = String.ToNumber(replace_3)
code_block_34 = CodeBlock { 180; }
code_block_35 = CodeBlock { null; }
eq_4 = code_block_35 == _  # unwired: arg1
replaceByCondition_2 = Replace(toNumber_3, code_block_34, eq_4)
code_block_36 = CodeBlock { 180; }
ge = replaceByCondition_2 >= code_block_36
if_ = If(test=ge, true=replaceByCondition_2, false=code_block_36)
filterByBoolMask_9 = List.FilterByBoolMask(list=if_, mask=isEmpty)
code_block_37 = CodeBlock { 10.7639104167097; }
mul = filterByBoolMask_9.out * code_block_37
setParameterByName_6 = Element.SetParameterByName(element=byPointAndLevel, parameterName=code_block_30.out0, value=mul)
code_block_38 = CodeBlock { "Dedicated Circuit_D"; }
list_getitematindex_dedicated = List.GetItemAtIndex(list=code_block_24@@L2, index=code_block_23.out3)
uniqueItems_5 = List.UniqueItems(list_getitematindex_dedicated@@L2)
flatten_3 = Flatten(uniqueItems_5)
filterByBoolMask_10 = List.FilterByBoolMask(list=flatten_3, mask=isEmpty)
setParameterByName_7 = Element.SetParameterByName(element=byPointAndLevel, parameterName=code_block_38, value=filterByBoolMask_10.out)
location_2 = FamilyInstance.Location(setParameterByName_7)
code_block_39 = CodeBlock { "PlugType_D"; }
list_getitematindex_plug_type = List.GetItemAtIndex(list=code_block_24@@L2, index=code_block_23.out4)
uniqueItems_6 = List.UniqueItems(list_getitematindex_plug_type@@L2)
flatten_4 = Flatten(uniqueItems_6)
filterByBoolMask_11 = List.FilterByBoolMask(list=flatten_4, mask=isEmpty)
setParameterByName_8 = Element.SetParameterByName(element=byPointAndLevel, parameterName=code_block_39, value=filterByBoolMask_11.out)
code_block_40 = CodeBlock { "Voltage_D"; }
code_block_41 = CodeBlock { 120; }
ge_2 = toNumber_2 >= code_block_41
if_2 = If(test=ge_2, true=toNumber_2, false=code_block_41)
filterByBoolMask_12 = List.FilterByBoolMask(list=if_2, mask=isEmpty)
string_from_object_3 = FromObject(filterByBoolMask_12.out)
setParameterByName_9 = Element.SetParameterByName(element=byPointAndLevel, parameterName=code_block_40, value=string_from_object_3)
