# Dynamo graph MED EQ Link Power Refresh.dyn (Dynamo 1.2.1.3083)

categories = Categories("ElectricalFixtures")
all_elements_of_category = ElementsOfCategory(categories)
watch = Watch(all_elements_of_category)
code_block = CodeBlock { "MedEQ ElementID_D"; }
getParameterValueByName = Element.GetParameterValueByName(element=watch, parameterName=code_block)
toNumber = String.ToNumber(getParameterValueByName)
isNull = Object.IsNull(toNumber@@L1)
filterByBoolMask = List.FilterByBoolMask(list=watch, mask=isNull)
code_block_2 = CodeBlock(ww=filterByBoolMask.out) { ww; }
code_block_3 = CodeBlock { "DistanceFromSource_D"; }
location = FamilyInstance.Location(code_block_2)
element_types = ElementTypes("RevitLinkInstance")
all_elements_of_type = ElementsOfType(element_types)
# note: EQ Link
code_block_4 = CodeBlock { 8; }
getItemAtIndex = List.GetItemAtIndex(list=all_elements_of_type, index=code_block_4)
categories_2 = Categories("SpecialityEquipment")
linkedInstanceElements = Custom[Springs.Collector.LinkedInstanceElements](LinkInstance=getItemAtIndex, category=categories_2)  # Extract elements by category from the selected linked instances. The transform vector can be used to get the exact location of the elements in the local file
id = Element.Id(linkedInstanceElements.elements)
string_from_object = FromObject(id)
code_block_5 = CodeBlock { "MedEQ ElementID_D"; }
getParameterValueByName_2 = Element.GetParameterValueByName(element=code_block_2, parameterName=code_block_5)
allIndicesOf = List.AllIndicesOf(list=string_from_object, item=getParameterValueByName_2)
flatten = Flatten(allIndicesOf)
getItemAtIndex_2 = List.GetItemAtIndex(list=linkedInstanceElements.elements, index=flatten)
location_2 = FamilyInstance.Location(getItemAtIndex_2)
byStartPointEndPoint = Line.ByStartPointEndPoint(startPoint=location, endPoint=location_2)
direction = Line.Direction(byStartPointEndPoint)
length = Vector.Length(direction)
abs = Math.Abs(length)
setParameterByName = Element.SetParameterByName(element=code_block_2, parameterName=code_block_3, value=abs)
maximumItem = List.MaximumItem(abs)
